# Grasshopper definition Example_Scene.gh (Grasshopper 1.0.7)

mesh = Mesh(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)
mesh_2 = Mesh([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])
spectral_match = SpectralMatch(Query=mesh, Database=mesh_2, Run=Toggle(False))  # -> out, Meshes, Scores, Info; inputs Query: Mesh, Database: list of Mesh, Run: Boolean
# ---------- spectral_match: Python ----------
__author__ = "Pouria Shahhoseini Nia"
__version__ = "2025.12.29"

import Rhino
import os
import json
import subprocess
import scriptcontext as sc

# --- 1. UTILITY FUNCTIONS ---
def export_temp_obj(mesh, filename, folder):
    filepath = os.path.join(folder, filename)
    try:
        with open(filepath, "w") as f:
            f.write("# Temp Export\n")
            for v in mesh.Vertices:
                f.write("v {} {} {}\n".format(v.X, v.Y, v.Z))
            for i in range(mesh.Faces.Count):
                face = mesh.Faces[i]
                if face.IsQuad:
                    f.write("f {} {} {} {}\n".format(face.A+1, face.B+1, face.C+1, face.D+1))
                else:
                    f.write("f {} {} {}\n".format(face.A+1, face.B+1, face.C+1))
        return filepath
    except:
        return None

# --- 2. MAIN LOGIC ---
Meshes = []
Scores = []
Info = "Ready."

# Validate Inputs
if Run and Query and Database and PythonPath and RepoPath:
    
    # 1. SETUP PATHS
    # We now put the temp folder INSIDE the repo
    cli_path = os.path.join(RepoPath, "apps", "similarity_search.py")
    temp_dir = os.path.join(RepoPath, ".temp_search")
    
    # Validation
    if not os.path.exists(cli_path):
        Info = "Error: Could not find apps/similarity_search.py at: " + cli_path
        
    elif not os.path.exists(PythonPath):
        Info = "Error: Python executable not found at: " + PythonPath
        
    else:
        # Create Temp Dir (Safe creation)
        if not os.path.exists(temp_dir): 
            try: os.makedirs(temp_dir)
            except Exception as e:
                Info = "Error creating temp folder: " + str(e)
                raise Exception("Permission denied creating temp folder.")
        
        # 2. EXPORT MESHES
        Info = "Exporting Query + " + str(len(Database)) + " database meshes..."
        q_path = export_temp_obj(Query, "query.obj", temp_dir)
        
        # Export Database
        for i, m in enumerate(Database):
            export_temp_obj(m, "db_{}.obj".format(i), temp_dir)
            
        # 3. RUN ENGINE via CLI
        json_out = os.path.join(temp_dir, "results.json")
        if os.path.exists(json_out):
            try: os.remove(json_out)
            except: pass

        Info = "Running Spectral Engine..."
        
        # Construct Command
        cmd = [
            PythonPath, 
            cli_path, 
            "search", 
            "-q", q_path, 
            "-d", temp_dir, 
            "-o", json_out, 
            "-k", "3"
        ]
        
        # Hide Console Window
        si = subprocess.STARTUPINFO()
        si.dwFlags |= subprocess.STARTF_USESHOWWINDOW
        
        try:
            # Run Process
            # Note: cwd=RepoPath is safer for imports
            process = subprocess.Popen(cmd, cwd=RepoPath, startupinfo=si)
            process.wait()

            if process.returncode != 0:
                Info = "CLI Error: process returned code {}".format(process.returncode)

            else:
                # 4. READ RESULTS
                if os.path.exists(json_out):
                    with open(json_out, 'r') as f:
                        data = json.load(f)
                    
                    matches = data.get("results", [])
                    Info = "Success! Found {} matches.\n".format(len(matches))
                    
                    for res in matches:
                        # Parse filename path/to/.temp_search/db_9.obj
                        full_path = res["file"]
                        fname = os.path.basename(full_path) # "db_9.obj"
                        
                        if fname.startswith("db_"):
                            try:
                                # Extract Index: "db_9.obj" -> 9
                                idx_str = fname.replace("db_", "").replace(".obj", "")
                                idx = int(idx_str)
                                
                                # Retrieve Mesh from original list
                                if idx < len(Database):
                                    Meshes.append(Database[idx])
                                    Scores.append(res["distance"])
                                    Info += " - Linked db_{} (Dist: {:.2f})\n".format(idx, res["distance"])
                                else:
                                    Info += " - Error: Index {} out of bounds\n".format(idx)
                            except Exception as e:
                                Info += " - Parse Error: {}\n".format(e)
                else:
                    Info = "Error: Results file was not created by the engine."
                    
        except Exception as e:
            Info = "System Error: " + str(e)
elif not Run:
    Info = "Set Run to True"
else:
    Info = "Missing Inputs. Please provide PythonPath and RepoPath."
# ---------- end spectral_match ----------
panel = Panel(spectral_match.out)
panel_2 = Panel(spectral_match.Scores)
panel_3 = Panel(spectral_match.Info)
mesh_3 = Mesh(spectral_match.Meshes)
